# Grasshopper definition Clips.gh (Grasshopper 1.0.7)

rectangle = Rectangle(Plane=PlaneXY(0, 0, 0), XSize=Slider(20, range=0..20), YSize=Slider(8, range=0..10), Radius=0)  # -> Rectangle, Length
vector_xyz = VectorXYZ(XComponent=0, YComponent=0, ZComponent=Slider(1, range=0..1))  # -> Vector, Length
vector_xyz_2 = VectorXYZ(XComponent=0, YComponent=0, ZComponent=Slider(4, range=0..10))  # -> Vector, Length
extrude = Extrude(Base=rectangle.Rectangle, Direction=vector_xyz.Vector)  # -> flatten(Extrusion)
rectangle_2 = Rectangle(Plane=vector_xyz_2.Vector, XSize=Slider(20, range=0..20), YSize=Slider(8, range=0..10), Radius=0)  # -> Rectangle, Length
vector_xyz_3 = VectorXYZ(XComponent=0, YComponent=0, ZComponent=Slider(1, range=0..1))  # -> Vector, Length
vector_xyz_4 = VectorXYZ(XComponent=Slider(9, range=0..10), YComponent=0, ZComponent=Slider(4, range=0..10))  # -> Vector, Length
vector_xyz_5 = VectorXYZ(XComponent=0, YComponent=0, ZComponent=Slider(-3, range=-10..10))  # -> Vector, Length
extrude_2 = Extrude(Base=flatten(rectangle_2.Rectangle), Direction=vector_xyz_3.Vector)
cap_holes = CapHoles(Brep=extrude)
rectangle_3 = Rectangle(Plane=vector_xyz_4.Vector, XSize=Slider(2, range=0..20), YSize=Slider(8, range=0..10), Radius=0)  # -> Rectangle, Length
cap_holes_2 = CapHoles(Brep=extrude_2)
extrude_3 = Extrude(Base=rectangle_3.Rectangle, Direction=flatten(vector_xyz_5.Vector))
cap_holes_3 = CapHoles(Brep=extrude_3)
merge = Merge(Data1=cap_holes, Data2=cap_holes_2, Data3=cap_holes_3)
solid_union = SolidUnion(Breps=merge)
rectangle_4 = Rectangle(Plane=PlaneXY(0, 0, 0), XSize=Slider(24, range=0..100), YSize=Slider(12, range=0..20), Radius=0)  # -> Rectangle, Length
box_array = BoxArray(Geometry=solid_union, Cell=rectangle_4.Rectangle, XCount=4, YCount=3, ZCount=2)  # -> Geometry, Transform
