# Grasshopper definition nest.gh (Grasshopper 1.0.7)

number_slider = Slider(4, range=0..4)
nullvector = Vector(Vector(0, 0, 0))
curve = Curve(<curve referenced from the Rhino model>)
linear_array = LinearArray(Geometry=curve, Direction=nullvector, Count=number_slider)  # -> Geometry, Transform
series = Series(Start=1, Step=Slider(0.612, range=0..1), Count=number_slider)
scale = Scale(Geometry=linear_array.Geometry, Center=Point(0, 0, 0), Factor=series)  # -> Geometry, Transform
offset_curve = OffsetCurve(Curve=scale.Geometry, Distance=Slider(0.333, range=0..4), Plane=PlaneXY(0, 0, 0), Corners=1)
merge = Merge(Data1=graft(scale.Geometry), Data2=offset_curve)
panel = Panel(merge)
boundary_surfaces = BoundarySurfaces(Edges=offset_curve)
boundary_surfaces_2 = BoundarySurfaces(Edges=merge)
unit_z = UnitZ(Factor=Slider(2.357, range=0..4))
unit_z_2 = UnitZ(Factor=Slider(0.333, range=0..4))
extrude = Extrude(Base=boundary_surfaces_2, Direction=unit_z)
extrude_2 = Extrude(Base=boundary_surfaces, Direction=unit_z_2)
merge_2 = Merge(Data1=extrude, Data2=extrude_2)
solid_union = SolidUnion(Breps=merge_2)
